# Grasshopper definition scriptable-braid-export-processer_1.0_draft.gh (Grasshopper 0.9.76)
# plug-ins: Python Interpreter, Anemone

loop_start = LoopStart(Repeat=Slider(4, range=0..4))  # -> port, Counter, Data
panel = Panel("""{0,0,0}
{0,0,2}
{0,0,4}
{0,0,6}""")
python = PythonScript(multiplier=loop_start.Counter, list=panel)  # -> vect_list; inputs multiplier: Int32, list: list of Point3d
# ---------- python: Python ----------
import Rhino as rc
import Rhino.Geometry as r
import scriptcontext as sc 
import rhinoscriptsyntax as rs

vect_list = []
for i in range(0,len(list)): 
    p = r.Point3d(0,0,list[i].Z * multiplier)
    vect_list.append(p)
# ---------- end python ----------
panel_2 = Panel(python)
loop_end = LoopEnd(port=loop_start.port, Exit=False, Data=python, pausedState=False, state="Constant output", TimeOutVal=0)
panel_3 = Panel(loop_end)
